% Requirement links of controller.slx (R2018a)

model links to throttleReqs.slreqx#1: controller_1: Must convert pedal signal into throttle control signal.
block :14 links to throttleReqs.slreqx#16: out_scl_1: Scaled data must be responsive t...
block :14 links to throttleReqs.slreqx#17: out_scl_2: Output data must be scaled for d...
block :3 links to throttleReqs.slreqx#4: inp_scl_1: Scaled data must be responsive t...
block :3 links to throttleReqs.slreqx#5: inp_scl_2: Output range for each signal must be normalized.